# Grasshopper definition example.gh (Grasshopper 1.0.7)
# plug-ins: baues-toolbox Info, THERB-GH

# ----
# 1-2.計算に必要な諸条件（北の方角、計算期間）を指定
vec = Vector(Vector(11.35901027, 6.301332919, 5))
exportt = ExportT(Start_month=Slider(1, range=0..1), End_month=Slider(12, range=0..100))

# ----
# step1. ジオメトリ、条件入力
# 1-1. ジオメトリ情報を入力
brep = Brep([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])
srf = Surface([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])
srf_2 = Surface(<surface referenced from the Rhino model>)
therb = THERB(Boxes=brep, Windows=srf, Tolerance=0.1)  # -> Therb, Test

readconstruction = ReadConstruction(Run=Toggle(True))
panel = Panel(readconstruction)
decompose = Decompose(Therb=therb.Therb)  # -> Rooms, Faces, Windows, Overhangs

number_slider = Slider(0.1, range=0..0.1)
windows_split = Surface([<surface referenced from the Rhino model> x3])
rooms_split = Brep([<brep referenced from the Rhino model> x20])

panel_2 = Panel(decompose.Faces)
brep_2 = Brep([<brep referenced from the Rhino model> x3])
filterfacebyproperty = FilterFaceByProperty(Faces=decompose.Faces, Bc=0, SurfT=0, Direction=-1)  # -> TrueFace, FalseFace
panel_3 = Panel(filterfacebyproperty.TrueFace)
item = ListItem(List=readconstruction, Index=Slider(4, range=0..15), Wrap=True)
panel_4 = Panel(item)
readproperty = ReadProperty()
updateconstruction = UpdateConstruction(Face=filterfacebyproperty.TrueFace, Construction=item)
merge = Merge(Data1=updateconstruction, Data2=filterfacebyproperty.FalseFace)  # -> flatten(Result)
compose = Compose(Rooms=decompose.Rooms, Faces=merge, Windows=decompose.Windows, Overhangs=decompose.Overhangs)
item_2 = ListItem(List=filterfacebyproperty.TrueFace, Index=Slider(0, range=0..15), Wrap=True)
exporta = ExportA(Therb=therb.Therb)
exportb = ExportB(Therb=compose)
exportr = ExportR(Therb=therb.Therb)
readfaceproperty = ReadFaceProperty()  # -> RoomId, PartId, Surface, ElementType, Normal, CenterPt, Direction, ConstructionId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
run_simulation = RunSimulation(Therb=therb.Therb, Name="TEST", Run=Toggle(False))
exportw = ExportW(Construction=readconstruction)

# ----
# step2. 出力をチェック
b_datファイル書き出し = Panel(exportb)
w_datファイル書き出し = Panel(exportw)
t_datデータ = Panel(exportt)
r_datファイル書き出し = Panel(exportr)

panel_5 = Panel(exporta)

# ----
# step03.
# サーバーにuploadする
# ための情報を入力
# step03-1. サーバーのドメイン入力
# (今のところ、ここは変える必要ないです）
# step03-2. プロジェクト名を入力
# step03-3. Trueにするとuploadして計算開始
panel_6 = Panel("http://localhost:5000/run")

uploadtherb = UploadTherb(Url=panel_6, ProjectName="demo2", Upload=Toggle(True))
# step04.
# サーバーからのresponseが表示されます。
# successとなっていれば、以下のurlをchrome
# で表示してください
# step05.
# 計算結果をPythonを利用してさらに分析することができます。
# 以下に分析例をまとめたJupyter Notebookを置いています。
# https://github.com/becat-oss/therb-notebook
panel_7 = Panel(uploadtherb)
